# Dynamo graph script.dyn (Dynamo 2.10.1.3976)
# packages: Data-Shapes 2021.2.91

# group: RESOURCES
python_script = Python()  # IronPython2
# ---------- python_script.python (43 lines) ----------
import sys
sys.path.append(r'C:\Program Files (x86)\IronPython 2.7\Lib')
sys.path.append(r'C:\Program Files (x86)\IronPython 2.7\Lib')

import clr, os

clr.AddReference('DynamoRevitDS')
import Dynamo 

clr.AddReference('RevitAPIUI')
from Autodesk.Revit.UI import *

def FindThreeDirectory(target, file_path):
	"""
	:param target: Caminho na árvore de pastas que compõe o script que se deseja encontrar
	:param file_path: Caminho do arquivo referência
	:return: Caminho de uma pasta pertencente a arvore de pasta de um arquivo
	"""
	count = 0
	lastpath = file_path.split(sep="\\")[-1]
	target_path = os.path.dirname(file_path)
	while count < 10:
		if lastpath == target:
			return target_path
			break
		lastpath = target_path.split(sep="\\")[-1]
		target_path = os.path.dirname(target_path)
		count += 1
	return None


dynamoRevit = Dynamo.Applications.DynamoRevit()
currentWorkspace = dynamoRevit.RevitDynamoModel.CurrentWorkspace	
script_path = currentWorkspace.FileName.replace('\Home.dyn', '')

path_parent = FindThreeDirectory("pyDelpro.tab", script_path)
if path_parent is None:
	OUT = TaskDialog.Show("Erro", "Não foi possível carregar a biblioteca RVTAPI. Reinstale o plugin ou contate o desenvolvedor.")
else:
	api_path = os.path.join(path_parent, "libs\\RVTAPI")
	dyna_logo = os.path.join(path_parent, "resources\\VZdynamologo.png")
	lib_path = os.path.join(path_parent, "libs")
	OUT = api_path, dyna_logo, lib_path
# ----------------------------------------
code_block = CodeBlock(py=python_script) { APIpath = py[0]; logo = py[1]; lib = py[2]; }

# group: LOGO
watch = Watch(code_block.logo)

# group: APIPATH
watch_2 = Watch(code_block.APIpath)

# group: BIBLIOTECA
watch_3 = Watch(code_block.lib)

# group: UI01
code_block_2 = CodeBlock { "Documento p/ leitura:"; "Tipo da Vista"; }
ui_filepath_data = Custom[UI.FilePath Data](InputName=code_block_2.out0)  # package Data-Shapes; Create filepath input for UI.MultipleInputForm ++ . Check out www.data-shapes.net for more infos !
python_script_2 = Python(IN[0]=watch_3)  # IronPython2
# ---------- python_script_2.python (30 lines) ----------
# Load the Python Standard and DesignScript Libraries
import sys
sys.path.append(r'C:\Program Files (x86)\IronPython 2.7\Lib')
sys.path.append(r'C:\Program Files (x86)\IronPython 2.7\Lib')
sys.path.append(IN[0])
import clr

clr.AddReference('RevitAPI')
import Autodesk
from Autodesk.Revit.DB import *

clr.AddReference('RevitServices')
from RevitServices.Persistence import DocumentManager
from RevitServices.Transactions import TransactionManager
# The inputs to this node will be stored as a list in the IN variables.
types = [[ViewType.FloorPlan, ViewType.EngineeringPlan, ViewType.AreaPlan],
		 [ViewType.Elevation, ViewType.Section, ViewType.Detail],
		 [ViewType.ThreeD, ViewType.Walkthrough],
		 [ViewType.CeilingPlan],
		 [ViewType.Legend]
		]
		
names = ['Floor Plan, Structural Plan, Area Plans',
		 'Elevations, Sections, Detail Views',
		 '3D Views, Walkthroughs',
		 'Ceiling Plans',
		 'Legends'
		]
# Assign your output to the OUT variable.
OUT = types, names
# ----------------------------------------
code_block_3 = CodeBlock { "Importar..."; ["View Template", "Filtros do View Template"]; [0,1]; 0; false; }
ui_dropdown_data = Custom[UI.DropDown Data](InputName=code_block_3.out0, Keys=code_block_3.out1, Values=code_block_3.out2, DefaultValueIndex=code_block_3.out3, Sorted_optional=code_block_3.out4)  # package Data-Shapes; Create data for DropDown input in UI.MultiInputForm ++ . Check out www.data-shapes.net for more infos.

code_block_4 = CodeBlock(a=python_script_2) { a[0]; a[1]; }
byKeysValues = DesignScript.Builtin.Dictionary.ByKeysValues(keys=code_block_4.out1, values=code_block_4.out0)

# group (continued): UI01
code_block_5 = CodeBlock(dict=byKeysValues) { dict; dict.Keys; 0; false; }
ui_dropdown_data_2 = Custom[UI.DropDown Data](InputName=code_block_2.out1, Keys=code_block_5.out1, Values=code_block_5.out1, DefaultValueIndex=code_block_5.out2, Sorted_optional=code_block_5.out3)
join = List.Join(list0=ui_filepath_data, list1=ui_dropdown_data_2, list2=ui_dropdown_data)
code_block_6 = CodeBlock(logo=watch, inputs=join) { "View Template Manager"; logo; inputs; true; "Cancel"; 600; }
ui_multipleinputform = Custom[UI.MultipleInputForm ++](Description_optional=code_block_6.out0, Logo_optional=code_block_6.logo, Inputs=code_block_6.inputs, Toggle=code_block_6.out3, CancelButtonText_optional=code_block_6.out4, Width_optional=code_block_6.out5)  # package Data-Shapes; Create a form with multiple inputs. see www.data-shapes.net for tutorials and infos!

code_block_7 = CodeBlock(ui=ui_multipleinputform.User_Inputs, dict=code_block_5.dict) { filepath = ui[0]; viewtype = dict.ValueAtKey(ui[1]); method = ui[2]; }
informações_do_docref_python = Python(IN[0]=watch_2, IN[1]=code_block_7.filepath, IN[2]=code_block_7.viewtype)  # "Informações do docRef(Python Script)"; IronPython2
# ---------- informações_do_docref_python.python (39 lines) ----------
# Load the Python Standard and DesignScript Libraries
import sys
sys.path.append(r'C:\Program Files (x86)\IronPython 2.7\Lib')
sys.path.append(r'C:\Program Files (x86)\IronPython 2.7\Lib')
import clr
clr.AddReference('ProtoGeometry')
from Autodesk.DesignScript.Geometry import *

clr.AddReference('RevitAPI')
import Autodesk
from Autodesk.Revit.DB import *

clr.AddReference('RevitServices')
from RevitServices.Persistence import DocumentManager

def GetViewTemplate(view):
	if not view: return None
	elif hasattr(view, "ViewTemplateId"):
		if view.ViewTemplateId.IntegerValue == -1: return None
		else: return view.Document.GetElement(view.ViewTemplateId)
	else: return None
	
# The inputs to this node will be stored as a list in the IN variables.
apipath = IN[0]
refpath = IN[1]
viewtypes = IN[2]
doc = DocumentManager.Instance.CurrentDBDocument

# Place your code below this line
reftemplates = []
app = doc.Application
refdoc = app.OpenDocumentFile(refpath)
refviews = FilteredElementCollector(refdoc).OfClass(View).ToElements()
for refview in refviews:
	viewtemp = GetViewTemplate(refview)
	reftemplates.append(viewtemp)
		
# Assign your output to the OUT variable.
OUT = reftemplates, refdoc
# ----------------------------------------
code_block_8 = CodeBlock(p=informações_do_docref_python) { templates = List.Clean(p[0], false); refdoc = p[1]; }

# group: UI METHOD 01
code_block_9 = CodeBlock(templates=code_block_8.templates) { "View Templates p/ importar"; templates; }
name = Element.Name(element=code_block_8.templates)
ui_listview_data = Custom[UI.Listview Data](InputName=code_block_9.out0, Keys=name, Values=code_block_9.templates)  # package Data-Shapes; Create data for ListView input in UI.MultiInputForm ++ . Check out www.data-shapes.net for more infos.
code_block_10 = CodeBlock(logo=watch, inputs=ui_listview_data, method=code_block_7.method) { "Import View Template"; logo; inputs; method == 0? true: false; "Cancel"; 600; }
ui_multipleinputform_2 = Custom[UI.MultipleInputForm ++](Description_optional=code_block_10.out0, Logo_optional=code_block_10.logo, Inputs=code_block_10.inputs, Toggle=code_block_10.out3, CancelButtonText_optional=code_block_10.out4, Width_optional=code_block_10.out5)

code_block_11 = CodeBlock(ui=ui_multipleinputform_2.User_Inputs, toogle=ui_multipleinputform_2.Was_Run) { viewtpl = ui[0]; toogle; }

# group: UI METHOD 02
code_block_12 = CodeBlock(templates=code_block_8.templates) { "View Template de referencia"; templates; }
ui_dropdown_data_3 = Custom[UI.DropDown Data](InputName=code_block_12.out0, Keys=name, Values=code_block_12.templates)
viewtemplates_python_script = Python()  # IronPython2
# ---------- viewtemplates_python_script.python (23 lines) ----------
# Load the Python Standard and DesignScript Libraries
import sys
sys.path.append(r'C:\Program Files (x86)\IronPython 2.7\Lib')
sys.path.append(r'C:\Program Files (x86)\IronPython 2.7\Lib')
import clr

clr.AddReference('RevitAPI')
import Autodesk
from Autodesk.Revit.DB import *

clr.AddReference('RevitServices')
from RevitServices.Persistence import DocumentManager
# The inputs to this node will be stored as a list in the IN variables.
doc = DocumentManager.Instance.CurrentDBDocument

# Place your code below this line
output = []
docviews = FilteredElementCollector(doc).OfClass(View).ToElements()
for docview in docviews:
	if docview.IsTemplate and docview.IsTemplate is not None:
		output.append(docview)
# Assign your output to the OUT variable.
OUT = output
# ----------------------------------------
code_block_13 = CodeBlock { false; }
clean = List.Clean(list=viewtemplates_python_script, preserveIndices=code_block_13)
code_block_14 = CodeBlock(templates=clean) { "View Templates locais"; templates; }
name_2 = Element.Name(element=clean)
ui_listview_data_2 = Custom[UI.Listview Data](InputName=code_block_14.out0, Keys=name_2, Values=code_block_14.templates)

join_2 = List.Join(list0=ui_dropdown_data_3, list1=ui_listview_data_2)

# group (continued): UI METHOD 02
code_block_15 = CodeBlock(logo=watch, inputs=join_2, method=code_block_7.method) { "Filtros a serem importados do View Template"; logo; inputs; method == 1? true: false; "Cancel"; 600; }
ui_multipleinputform_3 = Custom[UI.MultipleInputForm ++](Description_optional=code_block_15.out0, Logo_optional=code_block_15.logo, Inputs=code_block_15.inputs, Toggle=code_block_15.out3, CancelButtonText_optional=code_block_15.out4, Width_optional=code_block_15.out5)

code_block_16 = CodeBlock(ui=ui_multipleinputform_3.User_Inputs, toogle=ui_multipleinputform_3.Was_Run) { reference = ui[0]; viewtemplates = ui[1]; toogle; }
python_script_3 = Python(IN[1]=code_block_11.toogle, IN[2]=[code_block_16.toogle, code_block_16.toogle], IN[3]=code_block_11.viewtpl, IN[4]=[code_block_16.viewtemplates, code_block_16.viewtemplates], IN[5]=[code_block_16.reference, code_block_16.reference], IN[6]=code_block_8.refdoc, IN[7]=watch_3)  # IronPython2; unwired: IN[0]
# ---------- python_script_3.python (72 lines) ----------
# Load the Python Standard and DesignScript Libraries
import sys
sys.path.append(r'C:\Program Files (x86)\IronPython 2.7\Lib')
sys.path.append(r'C:\Program Files (x86)\IronPython 2.7\Lib')
sys.path.append(IN[7])
import clr
clr.AddReference('RevitAPI')
import Autodesk
from Autodesk.Revit.DB import *

clr.AddReference('RevitServices')
from RevitServices.Persistence import DocumentManager
from RevitServices.Transactions import TransactionManager

clr.AddReference('System')
from System.Collections.Generic import List as IList
# The inputs to this node will be stored as a list in the IN variables.
apipath = IN[0]
optone =  IN[1]
opttwo = IN[2]
optonevt = IN[3]
opttwovt = IN[4]
opttworef = IN[5]
refdoc = IN[6]

doc = DocumentManager.Instance.CurrentDBDocument
# Place your code below this line
output = []
if optone:
	TransactionManager.Instance.ForceCloseTransaction()
	vtplids = []
	for vtpl in optonevt:
		vtpl = UnwrapElement(vtpl)
		vtplids.append(vtpl.Id)
	# Cria um ICollection das views que serão copiadas
	opt = CopyPasteOptions()
	ivtpl = IList[ElementId](vtplids)
	# Copia os templates para o documento
	with Transaction(doc, "CopyPaste") as t:
		t.Start()
		copied = ElementTransformUtils.CopyElements(refdoc, ivtpl, doc, Transform.Identity, opt)
		output.append(copied)
		t.Commit()
elif opttwo:
	TransactionManager.Instance.ForceCloseTransaction()
	overrides = []
	visibility = []
	opttworef = UnwrapElement(opttworef)
	# Lê os filtros e os parâmetros de sobreposição associados ao mesmo
	filters = opttworef.GetFilters()
	for fil in filters:
		overrides.append(opttworef.GetFilterOverrides(fil))
		visibility.append(opttworef.GetFilterVisibility(fil))
	# Copia os filtros para o documento principal
	opt = CopyPasteOptions()
	with Transaction(doc, "CopyPaste") as t:
		t.Start()
		newfilters = ElementTransformUtils.CopyElements(refdoc, filters, doc, Transform.Identity, opt)
		t.Commit()
	# Aplica os filtros e os parâmetros para cada viewtemplate local escolhida
	with Transaction(doc, "FiltersApply") as t02:
		t02.Start()
		for viewtpl in opttwovt:
			viewtpl = UnwrapElement(viewtpl)
			for i, newfil in enumerate(newfilters):
				viewtpl.AddFilter(newfil)
				viewtpl.SetFilterOverrides(newfil, overrides[i])
				viewtpl.SetFilterVisibility(newfil, visibility[i])
			output.append(viewtpl)
		t02.Commit()
# Assign your output to the OUT variable.
OUT = output
# ----------------------------------------
